# Dynamo graph vbNodes.dyn (Dynamo 2.11.0.4533)

code_block = CodeBlock { 0..10; 10..0; }
createPoint = VBNetSample.VbNodes.CreatePoint(x=code_block.out0, y=code_block.out1)
desconstructPoint = VBNetSample.VbNodes.DesconstructPoint(point=createPoint)
list_create = List.Create(item0=desconstructPoint.x, item1=desconstructPoint.y, item2=desconstructPoint.z)
transpose = List.Transpose(lists=list_create)
watch = Watch(transpose)
